# Grasshopper definition 000.basic.ghx (Grasshopper 0.9.76)

crv = Curve([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])
crv_2 = Curve(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)
c_script = CSharpScript()  # -> out, A
# ---------- c_script: C# ----------
    var curve1 = NurbsCurve.CreateInterpolatedCurve(new Point3d[]{new Point3d(2, 0, 0),new Point3d(4, 0, 2),new Point3d(3, 0, 4)}, 3);
    A = Brep.CreateFromSweep(curve1, new Arc(new Circle(1), Math.PI * 7 / 4.0).ToNurbsCurve(), false, 0.1);
# ---------- end c_script ----------
c_script_2 = CSharpScript()  # -> out, A
# ---------- c_script_2: C# ----------
    var curve1 = NurbsCurve.CreateInterpolatedCurve(new Point3d[]{new Point3d(2, 0, 0),new Point3d(4, 0, 2),new Point3d(3, 0, 4)}, 3);
    A = Brep.CreatePipe(curve1, 1.0, false, PipeCapMode.Round, true, 0.1, 0.1);
# ---------- end c_script_2 ----------
c_script_3 = CSharpScript()  # -> out, A
# ---------- c_script_3: C# ----------
    A = RevSurface.Create(NurbsCurve.CreateInterpolatedCurve(new Point3d[]{new Point3d(2, 0, 0),new Point3d(4, 0, 2),new Point3d(3, 0, 4)}, 3), new Line(0, 0, 0, 0, 0, 10)).ToNurbsSurface();
# ---------- end c_script_3 ----------
c_script_4 = CSharpScript(x=crv)  # -> out, A; inputs x: list of Curve
# ---------- c_script_4: C# ----------
    A = Brep.CreateFromLoft(x, Point3d.Origin, Point3d.Origin + Vector3d.ZAxis * 8, LoftType.Loose, false);
# ---------- end c_script_4 ----------
c_script_5 = CSharpScript(x=crv_2)  # -> out, A; inputs x: Curve
# ---------- c_script_5: C# ----------
    A = Surface.CreateExtrusion(x, Vector3d.ZAxis * 10);
# ---------- end c_script_5 ----------
c_script_6 = CSharpScript()  # -> out, A; inputs x: Curve
# ---------- c_script_6: C# ----------
    A = new Rhino.Geometry.Point3d(1, 3, 4);
    A = new Rhino.Geometry.Vector3d(0, 4, 2);
    A = new Rhino.Geometry.Matrix(3, 3);
    A = new Rhino.Geometry.Plane(Point3d.Origin, Vector3d.XAxis, Vector3d.ZAxis);

    A = new Rhino.Geometry.Circle(4);
    A = new Rhino.Geometry.Arc(new Circle(5), Math.PI / 4.0);
    A = new Rhino.Geometry.BezierCurve(new Point3d[]{new Point3d(0, 0, 0),new Point3d(5, 3, 0),new Point3d(8, -1, 0)}).ToNurbsCurve();
    A = new Rhino.Geometry.Box(Plane.WorldXY, new Interval(0, 1), new Interval(-1, 1), new Interval(0, 3));
    A = new Rhino.Geometry.Cone(Plane.WorldXY, 10, 3);
    A = new Rhino.Geometry.Cylinder(new Circle(4), 10);
    A = new Rhino.Geometry.Line(Point3d.Origin, new Point3d(1, 4, 2));
    A = new Rhino.Geometry.Rectangle3d(Plane.WorldXY, 2, 4);
    A = new Rhino.Geometry.Torus(Plane.WorldXY, 10, 3);

    var p = new Rhino.Geometry.Polyline(0);
    p.Add(1, 3, 4);
    p.Add(4, 2, 8);
    p.Add(0, 2, 5);
    A = p;

    A = Rhino.Geometry.NurbsCurve.CreateInterpolatedCurve(new Point3d[]{new Point3d(0, 0, 0),new Point3d(5, 3, 0),new Point3d(8, -1, 0)}, 3);
# ---------- end c_script_6 ----------
