# Grasshopper definition 001.3dGraph.ghx (Grasshopper 0.9.76)

dom = ConstructDomain(DomainStart=Slider(-1, range=-10..0), DomainEnd=Slider(1, range=0..10))
dom_2 = ConstructDomain(DomainStart=Slider(-1, range=-10..0), DomainEnd=Slider(1, range=0..10))
c_script = CSharpScript(x=dom, y=dom_2)  # -> out, A
# ---------- c_script: C# ----------
    int uCount = 100;//u方向の解像度
    int vCount = 100;//v方向の解像度
    var points = new List<Point3d>();

    for(int u = 0;u < uCount;u++){
      for(int v = 0;v < vCount;v++){
        double uValue = ((double) u / (double) (uCount - 1)) * x.Length + x.Min;
        double vValue = ((double) v / (double) (vCount - 1)) * y.Length + y.Min;
        points.Add(GetPoint(uValue, vValue));
      }
    }

    A = Rhino.Geometry.NurbsSurface.CreateFromPoints(points.ToArray(), uCount, vCount, 3, 3);
# ---------- c_script: C# additional code ----------
  public static Point3d GetPoint(double u, double v){
    return new Point3d(u, v, Math.Pow(u, 2) - Math.Pow(v, 2));
  }
# ---------- end c_script ----------
