# Grasshopper definition 001.Bake.ghx (Grasshopper 0.9.76)

sph = Sphere(Base=PlaneXY(0, 0, 0), Radius=Slider(6, range=0..10))
bake = CSharpScript(x=sph)  # -> out; inputs x: GeometryBase
# ---------- bake: C# ----------
    RhinoDocument.Objects.Add(x);
# ---------- end bake ----------
