# Grasshopper definition 001.Generate.ghx (Grasshopper 0.9.76)

crv = Curve([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])
crv_2 = Curve(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)
c_script = CSharpScript(x=crv_2)  # -> out, A; inputs x: Curve
# ---------- c_script: C# ----------
    A = Surface.CreateExtrusion(x, Vector3d.ZAxis * 10);
# ---------- end c_script ----------
c_script_2 = CSharpScript(x=crv)  # -> out, A; inputs x: list of Curve
# ---------- c_script_2: C# ----------
    A = Brep.CreateFromLoft(x, Point3d.Origin, Point3d.Origin + Vector3d.ZAxis * 8, LoftType.Loose, false);
# ---------- end c_script_2 ----------
c_script_3 = CSharpScript()  # -> out, A
# ---------- c_script_3: C# ----------
    var curve1 = NurbsCurve.CreateInterpolatedCurve(new Point3d[]{new Point3d(2, 0, 0),new Point3d(4, 0, 2),new Point3d(3, 0, 4)}, 3);
    A = Brep.CreatePipe(curve1, 1.0, false, PipeCapMode.Round, true, 0.1, 0.1);
# ---------- end c_script_3 ----------
c_script_4 = CSharpScript()  # -> out, A
# ---------- c_script_4: C# ----------
    A = RevSurface.Create(NurbsCurve.CreateInterpolatedCurve(new Point3d[]{new Point3d(2, 0, 0),new Point3d(4, 0, 2),new Point3d(3, 0, 4)}, 3), new Line(0, 0, 0, 0, 0, 10)).ToNurbsSurface();
# ---------- end c_script_4 ----------
c_script_5 = CSharpScript()  # -> out, A
# ---------- c_script_5: C# ----------
    var curve1 = NurbsCurve.CreateInterpolatedCurve(new Point3d[]{new Point3d(2, 0, 0),new Point3d(4, 0, 2),new Point3d(3, 0, 4)}, 3);
    A = Brep.CreateFromSweep(curve1, new Arc(new Circle(1), Math.PI * 7 / 4.0).ToNurbsCurve(), false, 0.1);
# ---------- end c_script_5 ----------
move = Move(Geometry=c_script_5.A, Motion=Vector(75, 0, 0))  # -> Geometry, Transform
move_2 = Move(Geometry=c_script_4.A, Motion=Vector(50, 0, 0))  # -> Geometry, Transform
move_3 = Move(Geometry=c_script_3.A, Motion=Vector(100, 0, 0))  # -> Geometry, Transform
move_4 = Move(Geometry=c_script_2.A, Motion=Vector(25, 0, 0))  # -> Geometry, Transform
