# Grasshopper definition 002.BakeAdvanced.ghx (Grasshopper 0.9.76)

sph = Sphere(Base=PlaneXY(0, 0, 0), Radius=Slider(6, range=0..10))
col = Colour(RGB(222, 245, 15))
bake = CSharpScript(obj=sph, color=col, layer="One Layer", bake=Toggle(False))  # -> out; inputs obj: GeometryBase, color: list of Color, layer: String, bake: Boolean
# ---------- bake: C# ----------
    try{
      var objAttr = new ObjectAttributes();
      if(color.Count() != 0){
        objAttr.ColorSource = ObjectColorSource.ColorFromObject;
        objAttr.ObjectColor = color[0];
      }
      if(layer != ""){
        objAttr.LayerIndex = GetLayerNumber(RhinoDocument, layer);
      }
      if(bake){
        RhinoDocument.Objects.Add(obj, objAttr);
      }
    }catch(Exception e){
      Print(e.ToString());
    }
# ---------- bake: C# additional code ----------
  public int GetLayerNumber(RhinoDoc rd, string layerName){
    int layerCount = rd.Layers.FindByFullPath(layerName, true);
    if(layerCount == -1){
      layerCount = rd.Layers.Add(layerName, Color.White);
    }
    return layerCount;
  }
# ---------- end bake ----------
