# Grasshopper definition 002.Transform.ghx (Grasshopper 0.9.76)

cone = CSharpScript()  # -> A
# ---------- cone: C# ----------
    A = new Rhino.Geometry.Cone(Plane.WorldXY, 10, 3);
# ---------- end cone ----------
c_script = CSharpScript(x=cone)  # -> out, A; inputs x: Brep
# ---------- c_script: C# ----------
    x.Translate(1, 3, 4);
    A = x;
# ---------- end c_script ----------
c_script_2 = CSharpScript(x=cone)  # -> out, A; inputs x: Brep
# ---------- c_script_2: C# ----------
    x.Transform(Transform.Mirror(Plane.WorldXY));
    A = x;
# ---------- end c_script_2 ----------
c_script_3 = CSharpScript(x=cone)  # -> out, A; inputs x: Brep
# ---------- c_script_3: C# ----------
    x.Transform(Transform.PlaneToPlane(Plane.WorldXY, new Plane(Point3d.Origin, new Vector3d(-1, 1, 0))));
    A = x;
# ---------- end c_script_3 ----------
c_script_4 = CSharpScript(x=cone)  # -> out, A; inputs x: Brep
# ---------- c_script_4: C# ----------
    x.Transform(Transform.Rotation(Math.PI / 3.0, Vector3d.XAxis, Point3d.Origin));
    A = x;
# ---------- end c_script_4 ----------
