# Grasshopper definition 003.3dGraphClass.ghx (Grasshopper 0.9.76)

c_script = CSharpScript()  # -> out, A
# ---------- c_script: C# ----------
    {
      var AnntennGraph = new Graph3d((u,v) => {return new Point3d(u, v, u * u - v * v);});
      AnntennGraph.BakeSurface(RhinoDocument, 100, 100);
    }
    {
      var AnntennGraph = new Graph3d((u,v) => {return new Point3d(u, v, u * u *u + v * v);});
      var surf2 = AnntennGraph.GetSurface(100, 100);
      surf2.Translate(2, 0, 0);
      RhinoDocument.Objects.Add(surf2);
    }
# ---------- c_script: C# additional code ----------
  /// <summary>
  /// 3dグラフを示すクラスです。
  /// </summary>
  public class Graph3d{
    public delegate Point3d Function3d(double u,double v);
    public Function3d F;

    public Interval uInterval = new Interval(-1, 1);
    public Interval vInterval = new Interval(-1, 1);

    public Graph3d(Function3d f){
      this.F = f;
    }

    public Surface GetSurface(int uCount, int vCount){
      var points = new List<Point3d>();

      for(int u = 0;u < uCount;u++){
        for(int v = 0;v < vCount;v++){
          double uValue = ((double) u / (double) (uCount - 1)) * uInterval.Length + uInterval.Min;
          double vValue = ((double) v / (double) (vCount - 1)) * vInterval.Length + vInterval.Min;
          points.Add(F(uValue, vValue));
        }
      }
      return NurbsSurface.CreateFromPoints(points, uCount, vCount, 3, 3);
    }

    public void BakeSurface(RhinoDoc rd, int uCount, int vCount){
      rd.Objects.Add(GetSurface(uCount, vCount));
    }
  }
# ---------- end c_script ----------
