# Grasshopper definition 003.Bake.ghx (Grasshopper 0.9.76)

sph = Sphere(Base=PlaneXY(0, 0, 0), Radius=Slider(6, range=0..10))
bake = CSharpScript(x=sph)  # -> out; inputs x: GeometryBase
# ---------- bake: C# ----------
    RhinoDocument.Objects.Add(x);
# ---------- end bake ----------
bake_on_off = CSharpScript(x=sph, y=Toggle(False))  # -> out, A; inputs x: GeometryBase, y: Boolean
# ---------- bake_on_off: C# ----------
    if(y){RhinoDocument.Objects.Add(x);}
# ---------- end bake_on_off ----------
