# Grasshopper definition 003.CurveAnalysis.ghx (Grasshopper 0.9.76)

crv = Curve(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)
c_script = CSharpScript(x=crv)  # -> out, A, B; inputs x: Curve
# ---------- c_script: C# ----------
    x.Domain = new Interval(0, 1);
    A = x.PointAt(0.5);
    B = x.PointAtNormalizedLength(0.5);
# ---------- end c_script ----------
c_script_2 = CSharpScript(x=crv)  # -> out, A; inputs x: Curve
# ---------- c_script_2: C# ----------
    double l=x.GetLength();//長さを評価
    BoundingBox b = x.GetBoundingBox(true);//バウンディングボックス(曲線を覆う箱)を取得。
# ---------- end c_script_2 ----------
c_script_3 = CSharpScript(x=crv)  # -> out, A; inputs x: Curve
# ---------- c_script_3: C# ----------
    double t;
    x.LengthParameter(1.4, out t);//始点からの長さでパラメーターを取得する。
    x.NormalizedLengthParameter(0.3, out t);//始点からの長さの曲線長に対する割合でパラメーターを取得する。
    x.ClosestPoint(new Point3d(0, 0, 0), out t);//ある点からもっとも近い曲線上の点を取得する。
# ---------- end c_script_3 ----------
c_script_4 = CSharpScript(x=crv)  # -> out, A, B, C; inputs x: Curve
# ---------- c_script_4: C# ----------
    double t;
    x.ClosestPoint(new Point3d(0, 0, 0), out t);//ある点からもっとも近い曲線上の点を取得する。

    A = x.PointAt(t);//パラメーターの示す座標を取得
    B = x.CurvatureAt(t);//その点での曲率ベクトルを取得。
    C = x.TangentAt(t);//その点での接線ベクトルを取得。
# ---------- end c_script_4 ----------
