# Grasshopper definition 007.Developable.ghx (Grasshopper 0.9.76)

c_script = CSharpScript()  # -> out, A
# ---------- c_script: C# ----------
    var points = new List<Point3d>();

    Curve cv;

    var cvpts = new List<Point3d>();
    for(double u = 0;u < Math.PI * 3;u += 0.3){
      cvpts.Add(new Point3d(Math.Sin(u), Math.Cos(u), u));
    }
    cv = Rhino.Geometry.NurbsCurve.CreateInterpolatedCurve(cvpts, 3);

    cv.Domain = new Interval(0, 1);
    int cnt = 100;
    int vcnt = 100;
    double vlen = 10;

    for(int i = 0;i < cnt;i++){
      Vector3d tan = cv.TangentAt((double) i / (double) cnt);
      Point3d org = cv.PointAt((double) i / (double) cnt);
      //vlen = tan.X == 0 ? 10 : (20 - org.X) / tan.X;
      for(int j = 0;j < vcnt;j++){
        points.Add(org + tan * vlen * (double) j / (double) vcnt);
      }
    }

    A = cv;
    A = Rhino.Geometry.NurbsSurface.CreateFromPoints(points.ToArray(), cnt, vcnt, 3, 3);
# ---------- end c_script ----------
