# Grasshopper definition 010.functionCurve.ghx (Grasshopper 0.9.76)

c_script = CSharpScript()  # -> out, A
# ---------- c_script: C# ----------
    var points = new List<Point3d>();//サンプル点。
    int tCount = 100;//サンプル点の数。
    var tInterval = new Interval(0, 2);//関数の描画範囲。
    for(double t = tInterval.Min;t <= tInterval.Max;t += tInterval.Length / tCount){//tIntervalの最小値からtIntervalの最大値までtLength/tCountずつ増やして繰り返し。
      points.Add(new Point3d(t, Math.Pow(t, 2), Math.Pow(t, 3)));//(t,t^2,t^3)のサンプルを追加。
    }
    A = Rhino.Geometry.NurbsCurve.CreateInterpolatedCurve(points, 3);//pointsを滑らかにつなぐ。
# ---------- end c_script ----------
class = CSharpScript()  # -> out, A
# ---------- class: C# ----------
    var cf = new CurveFunction((t) => {return new Point3d(Math.Sin(t), Math.Cos(t), t);});//(sin(t),cos(t),t)の関数からCurveFunction型の変数を作る。
    cf.tInterval = new Interval(0, 3 * Math.PI);//0～3πまで描画するように指定する。
    A = cf.GetCurve(100);//サンプル数100で実際の曲線を作成する。
    //cf.BakeCurve(RhinoDocument, 100);//サンプル数100で実際の曲線を作成してBakeする。
# ---------- class: C# additional code ----------
  /// <summary>
  /// 自由曲線を示すクラスです。
  /// </summary>
  public class CurveFunction{
    public delegate Point3d Function3d(double u);
    /// <summary>
    /// グラフで描画する関数。
    /// </summary>
    public Function3d F;

    /// <summary>
    /// 直線の描画範囲。
    /// </summary>
    public Interval tInterval = new Interval(-1, 1);

    /// <summary>
    /// コンストラクタ。
    /// </summary>
    /// <param name="f">グラフで描画する関数。</param>
    public CurveFunction(Function3d f){
      this.F = f;
    }

    /// <summary>
    /// 関数が示す曲線をサーフェスとして取得します。
    /// </summary>
    /// <param name="tCount">曲線の解像度</param>
    /// <returns>目的の形状。</returns>
    public Curve GetCurve(int tCount=100){
      var points = new List<Point3d>();

      for(int t = 0;t < tCount;t++){
        double tValue = ((double) t / (double) (tCount - 1)) * tInterval.Length + tInterval.Min;
        points.Add(F(tValue));
      }
      return Rhino.Geometry.NurbsCurve.CreateInterpolatedCurve(points, 3);
    }

    /// <summary>
    /// 関数が示すサーフェスをBakeします。
    /// </summary>
    /// <param name="RhinoDocument">通常はRhinoDocumentと入力してください。</param>
    /// <param name="tCount">直線の解像度。</param>
    /// <returns></returns>
    public void BakeCurve(RhinoDoc RhinoDocument, int tCount){
      RhinoDocument.Objects.Add(GetCurve(tCount));
    }
  }
# ---------- end class ----------
