# Grasshopper definition 012.3dGraphClass.ghx (Grasshopper 0.9.76)

c_script = CSharpScript()  # -> out, A
# ---------- c_script: C# ----------
    {
      var AnntennGraph = new Graph3d((u,v) => {return new Point3d(u, v, u * u - v * v);});
      AnntennGraph.BakeSurface(RhinoDocument, 100, 100);
    }
    {
      var AnntennGraph = new Graph3d((u,v) => {return new Point3d(u, v, u * u * u + v * v);});
      var surf2 = AnntennGraph.GetSurface(100, 100);
      surf2.Translate(2, 0, 0);
      RhinoDocument.Objects.Add(surf2);
    }
# ---------- c_script: C# additional code ----------
  /// <summary>
  /// 3dグラフを示すクラスです。
  /// </summary>
  public class Graph3d{
    public delegate Point3d Function3d(double u,double v);
    /// <summary>
    /// グラフで描画する関数。
    /// </summary>
    public Function3d F;

    /// <summary>
    /// u方向の描画範囲。
    /// </summary>
    public Interval uInterval = new Interval(-1, 1);
    /// <summary>
    /// v方向の描画範囲。
    /// </summary>
    public Interval vInterval = new Interval(-1, 1);

    /// <summary>
    /// コンストラクタ。
    /// </summary>
    /// <param name="f">グラフで描画する関数。</param>
    public Graph3d(Function3d f){
      this.F = f;
    }

    /// <summary>
    /// 関数が示すグラフをサーフェスとして取得します。
    /// </summary>
    /// <param name="uCount">u方向の解像度</param>
    /// <param name="vCount">v方向の解像度。</param>
    /// <returns>目的の形状。</returns>
    public Surface GetSurface(int uCount=100, int vCount=100){
      var points = new List<Point3d>();

      for(int u = 0;u < uCount;u++){
        for(int v = 0;v < vCount;v++){
          double uValue = ((double) u / (double) (uCount - 1)) * uInterval.Length + uInterval.Min;
          double vValue = ((double) v / (double) (vCount - 1)) * vInterval.Length + vInterval.Min;
          points.Add(F(uValue, vValue));
        }
      }
      return NurbsSurface.CreateFromPoints(points, uCount, vCount, 3, 3);
    }

    /// <summary>
    /// 関数が示すサーフェスをBakeします。
    /// </summary>
    /// <param name="RhinoDocument">通常はRhinoDocumentと入力してください。</param>
    /// <param name="uCount">u方向の解像度。</param>
    /// <param name="vCount">v方向の解像度。</param>
    /// <returns></returns>
    public void BakeSurface(RhinoDoc RhinoDocument, int uCount, int vCount){
      RhinoDocument.Objects.Add(GetSurface(uCount, vCount));
    }
  }
# ---------- end c_script ----------
