# Grasshopper definition 014.BakeColor.ghx (Grasshopper 0.9.76)

sph = Sphere(Base=PlaneXY(0, 0, 0), Radius=Slider(6, range=0..10))
c_script = CSharpScript(x=sph)  # -> out, A; inputs x: GeometryBase
# ---------- c_script: C# ----------
    var oba = new ObjectAttributes();
    oba.ColorSource = ObjectColorSource.ColorFromObject;
    oba.ObjectColor = Color.Red;
    RhinoDocument.Objects.Add(x, oba);
# ---------- end c_script ----------
